# Grasshopper definition SAMPLE_surface_split_at_tangents.gh (Grasshopper 1.0.7)

# ---- group: Rectangle + Fillet
rectangle = Rectangle(Plane=PlaneXY(0, 0, 0), XSize="200", YSize="200", Radius=0)  # -> Rectangle, Length
fillet = FilletDistance(Curve=rectangle.Rectangle, Distance="30")

# ---- group: C-Channel Profile (Internalize)
crv = Curve(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)

# ----
crv_2 = Curve([fillet, crv])
Z = UnitZ(Factor="1000")
extr = Extrude(Base=crv_2, Direction=Z)
cap = CapHoles(Brep=extr)

# ---- group: Before
edges = BrepEdges(Brep=cap)  # -> Naked, Interior, NonManifold

# ----
splitfacesattangents_by_rc = SplitFacesAtTangentsByRC(BREP=cap)  # -> out, RESULT; inputs BREP: Brep
# ---------- splitfacesattangents_by_rc: Python ----------
import Rhino.Geometry as rg
import rhinoscriptsyntax as rs

TOLERANCE = rs.UnitAbsoluteTolerance()


if BREP:
    BREP.Faces.SplitFacesAtTangents();
    RESULT = BREP 


msg = "SplitFacesAtTangents by RC"
ghenv.Component.Message = msg


print("Article >>> https://blog.vicc.jp/entry/surface_split_at_tangents")

### Article >>>
### https://blog.vicc.jp/entry/surface_split_at_tangents
# ---------- end splitfacesattangents_by_rc ----------
panel = Panel(splitfacesattangents_by_rc.out)

# ---- group: After
edges_2 = BrepEdges(Brep=splitfacesattangents_by_rc.RESULT)  # -> Naked, Interior, NonManifold
